# Grasshopper definition 20241004.gh (Grasshopper 1.0.8)
# plug-ins: RhinoCodePluginGH

geometry_pipeline = GeometryPipeline(
    GroupByLayer=False,
    GroupByType=False,
    IncludeHidden=True,
    IncludeLocked=True,
    LayerFilter="Default",
    NameFilter="*",
    SublayerFiltering=True,
    TypeFilter=4)
spacing_between_elements = Slider(6, range=0..12)
array_amount = Slider(12, range=1..12)
# single element
grid_generator = Python3Script(y=spacing_between_elements, z=array_amount)  # -> a; disabled
# ---------- grid_generator: Python ----------
# Grid Generator -> Single (2D) Element

import rhinoscriptsyntax as rs
import Rhino.Geometry as rg
import math

def create_tessellating_grid(geometries, extra_spacing, total_count):
    grid = []
    
    # Calculate the overall bounding box for all geometries
    all_points = [point for geo in geometries for point in rs.BoundingBox(geo)]
    min_x = min(point.X for point in all_points)
    min_y = min(point.Y for point in all_points)
    max_x = max(point.X for point in all_points)
    max_y = max(point.Y for point in all_points)
    
    pattern_width = max_x - min_x + extra_spacing
    pattern_height = max_y - min_y + extra_spacing
    
    # Calculate rows and columns based on the square root of total_count
    side_count = math.ceil(math.sqrt(total_count))
    
    for i in range(side_count):
        for j in range(side_count):
            if len(grid) >= total_count:
                break
            x_offset = j * pattern_width
            y_offset = i * pattern_height
            for geo in geometries:
                translation_vector = rg.Vector3d(x_offset, y_offset, 0)
                transformed_geo = rs.CopyObject(geo, translation_vector)
                grid.append(transformed_geo)
    
    return grid[:total_count]  # Ensure we return exactly the number of items specified by z

# Input parameters
x = x  # List of input geometries
y = y  # Extra spacing slider
z = z  # Total count slider

# Ensure inputs are correct type
if not isinstance(x, list):
    x = [x]
y = float(y)
z = int(z)

# Generate the tessellating grid
result = create_tessellating_grid(x, y, z)

# Output
a = result
# ---------- end grid_generator ----------
# multiple elements
grid_generator_2 = Python3Script(x=geometry_pipeline, y=spacing_between_elements, z=array_amount)  # -> a
# ---------- grid_generator_2: Python ----------
import rhinoscriptsyntax as rs
import Rhino.Geometry as rg
import ghpythonlib.components as ghc
import math

def create_tessellating_grid(geometries, extra_spacing, total_count):
    # Ensure geometries is a list
    if not isinstance(geometries, list):
        geometries = [geometries]
    
    # Calculate bounding box
    bbox = rg.BoundingBox.Unset
    for geo in geometries:
        if isinstance(geo, rg.GeometryBase):
            bbox.Union(geo.GetBoundingBox(True))
    
    if not bbox.IsValid:
        raise ValueError("Invalid bounding box. Check input geometries.")
    
    pattern_width = bbox.Max.X - bbox.Min.X + extra_spacing
    pattern_height = bbox.Max.Y - bbox.Min.Y + extra_spacing
    
    # Calculate rows and columns based on the square root of total_count
    side_count = int(math.ceil(math.sqrt(total_count)))
    
    grid = []
    for i in range(side_count):
        for j in range(side_count):
            if len(grid) // len(geometries) >= total_count:
                break
            x_offset = j * pattern_width
            y_offset = i * pattern_height
            
            # Move all geometries together as a single unit
            unit = []
            for geo in geometries:
                if isinstance(geo, rg.GeometryBase):
                    new_geo = geo.Duplicate()
                    new_geo.Translate(rg.Vector3d(x_offset, y_offset, 0))
                    unit.append(new_geo)
            grid.extend(unit)
    
    return grid[:total_count * len(geometries)]

# Input parameters
x = x  # List of input geometries
y = y  # Extra spacing slider
z = z  # Total count slider

# Ensure inputs are correct type
y = float(y)
z = int(z)

# Generate the tessellating grid
result = create_tessellating_grid(x, y, z)

# Output
a = result
# ---------- end grid_generator_2 ----------
curve = Curve(grid_generator)  # disabled
curve_2 = Curve(grid_generator_2)
